vi "index.gviweb"   [LabVIEW NXG 3.1.0]
# This template is for the Queued Message Handler design pattern. The Event Handling Loop generates messages based on user interface actions. The Message Handling Loop processes messages generated by the Event Handling Loop, or by other messages. The messages are string values, so new messages can be added easily to the Message Cases case structure in the Message Handling Loop. Each message cluster can also provide an optional value for Message Data,  which is a String that can be swapped to whatever type of data is required.
panel controls:
  "Controls": T1
  "Hyperlink Control": string = "https://www.mediamongrels.com/blog"
  "Your Name": string
panel indicators:
  "Countdown": f64
  "URL Image": string
  "Connected?": bool
  "Last Result": cluster{"Vote": string, "Count": u16}[]
  "Current Vote Status": cluster{"Stat": string, "Count": u16}[]
types:
  T1 = cluster{"Forward": bool, "Left": bool, "Right": bool, "Back": bool}
  T2 = cluster{"Vote Frequency (s)": f64, "Time Remaining": f64, "# Voters": i32, "Vote Count": i32}
uses:
  Library::Message Queue::Create All Message Queues.gviweb
  Library::Message Queue::Enqueue Message (Single).gviweb
  Library::Message Queue::Dequeue Message.gviweb
  Library::Message Queue::Enqueue Message (Array).gviweb
  NI::WebSockets::Close WebSocket.gvi
  NI::G Core::Error::Clear Error Cluster.gvi
  Library::GetHostname.jsli::GetHostname
  NI::WebSockets::Open WebSocket.gvi
  NI::WebSockets::Write String.gvi
  NI::WebSockets::Read String.gvi
  NI::G Core::Error::Read Error Code.gvi
  NI::G Core::Error::Build Error Cluster.gvi
diagram:
  Random Number() -> (number (0 to 1)=w1)
  Multiply(1000, w1) -> w2
  Round To Nearest(number=w2) -> w3
  Format Into String(formatString="Player_%04d", w3) -> w4
  $"Your Name" <- w4
  call "Create All Message Queues.gviweb"() -> (message queues=w5, error out=w6)
  Property Node(instance in=w5) -> ("UI"=w7)
  while {
    event {
      on "Controls" Value changed {
        Property Node(instance in=reference to "Controls", "Disabled"=TRUE)
        Event Data() -> ("New Value"=w9)
        Cluster To Array(cluster=w9) -> (array=w10)
        s1 = w7  # shift register
        s2 = uninitialised  # shift register
        for {
          w11 = each element of w10
          w12 = each element of ["Forward", "Left", "Right", "Back"]
          case (w11) {
            frame False, Default {
              w13 = s2
              w14 = s1
            }
            frame True {
              call "Enqueue Message (Single).gviweb"(message queue in=s1, message=w12, error in=s2) -> (message queue out=w14, error out=w13)
            }
          }
          next s1 = w14
          next s2 = w13
        }
        w8 = s2
      }
      on "Your Name" Value changed {
        call "Enqueue Message (Single).gviweb"(message queue in=w7, message="Send Name") -> (message queue out=w15, error out=w8)
      }
    }
    stop if FALSE
  }
  w16 = cluster{"Connected?": bool, "websocket": u32} {all zero or empty}
  s3 = w16  # shift register
  while {
    call "Dequeue Message.gviweb"(message queue in=w7, error in=w6) -> (message queue out=w17, message=w18, message data=w19, error out=w20)
    # s3: Data
    case (w18) ignore case {  # Message Cases
      frame "Initialise" {
        Property Node(instance in=s3, "Connected?"=FALSE) -> (instance out=w22)
        $"Current Vote Status" <- cluster{"Stat": string, "Count": f64}[] []
        $"Last Result" <- cluster{"Vote": string, "Count": f64}[] []
        call "Enqueue Message (Array).gviweb"(message queue in=w17, message array=["Update Display", "Connect"], error in=w20) -> (error out=w21)
      }
      frame "Connect" {
        Property Node(instance in=s3) -> ("websocket"=w23, instance out=w24)
        call "Close WebSocket.gvi"(websocket session in=w23, error in=w20) -> (error out=w25)
        call "Clear Error Cluster.gvi"(error in=w25) -> (error out=w26)
        call "GetHostname"(error in=w26) -> (return=w27, error out=w28)
        Format Into String(formatString="ws://%s:6123/", errIn=w28, w27) -> (outString=w29, errOut=w30)
        call "Open WebSocket.gvi"(url=w29, error in=w30) -> (websocket session out=w31, error out=w32)
        case (w32) {
          frame Error, Default {
            Wait(time to wait=1000)
            call "Enqueue Message (Single).gviweb"(message queue in=w17, message="Connect") -> (error out=w33)
            Merge Errors(w33, w32) -> (error out=w21)
            w22 = w24
          }
          frame No Error {
            Property Node(instance in=w24, "Connected?"=TRUE, "websocket"=w31) -> (instance out=w22)
            call "Enqueue Message (Array).gviweb"(message queue in=w17, message array=["Update Display", "Send Name", "Read"], error in=w32) -> (error out=w21)
          }
        }
      }
      frame "Send Name" {
        Property Node(instance in=s3) -> ("websocket"=w34, instance out=w22)
        w35 = cluster{"command": string, "data": string} {all zero or empty}
        Property Node(instance in=w35, "command"="Name", "data"=$"Your Name") -> (instance out=w36)
        Flatten To JSON(anything=w36, error in (no error)=w20) -> (JSON string=w37, error out=w38)
        call "Write String.gvi"(websocket session in=w34, string message=w37, error in=w38) -> (error out=w21)
      }
      frame "Update Display" {
        Property Node(instance in=s3) -> ("Connected?"=w39, instance out=w22)
        Not(x=w39) -> w40
        Property Node(instance in=reference to "Current Vote Status", "Disabled"=w40)
        Property Node(instance in=reference to "Controls", "Disabled"=w40)
        $Controls <- T1 {all zero or empty}
        Property Node(instance in=reference to "Countdown", "Disabled"=w40)
        Property Node(instance in=reference to "Last Result", "Disabled"=w40)
        $Countdown <- 0
        $"Connected?" <- w39
        w21 = w20
      }
      frame "Read" {
        Property Node(instance in=s3) -> ("websocket"=w41, instance out=w22)
        call "Read String.gvi"(websocket session in=w41, timeout=0.1, error in=w20) -> (string response=w42, error out=w43)
        call "Read Error Code.gvi"(error in=w43) -> (code=w44)
        case (w44) {
          frame Default {
            call "Enqueue Message (Single).gviweb"(message queue in=w17, message="Disconnected") -> (error out=w45)
            Merge Errors(w45, w43) -> (error out=w21)
          }
          frame 0 {
            Unflatten From JSON(JSON string=w42, error in (no error)=w43, path=["command"], type and defaults=string "") -> (error out=w46, value=w47)
            case (w47) ignore case {
              frame Default {
                Format Into String(formatString="Unrecognised JSON command '%s'", errIn=w46, w47) -> (outString=w49, errOut=w50)
                call "Build Error Cluster.gvi"(error in=w50, code=1, description=w49) -> (error out=w48)
              }
              frame "Vote Starts" {
                Property Node(instance in=reference to "Controls", "Disabled"=FALSE)
                $Controls <- T1 {all zero or empty}
                w48 = w46
              }
              frame "Voting Ended" {
                Property Node(instance in=reference to "Controls", "Disabled"=TRUE)
                Unflatten From JSON(JSON string=w42, error in (no error)=w46, path=["data"], type and defaults=cluster{"Vote": string, "Count": i32}[] []) -> (error out=w48, value=w51)
                $"Last Result" <- w51
              }
              frame "Vote Status" {
                Unflatten From JSON(JSON string=w42, error in (no error)=w46, path=["data"], type and defaults=T2 {all zero or empty}) -> (error out=w48, value=w52)
                Property Node(instance in=w52) -> ("Time Remaining"=w53, "Vote Frequency (s)"=w54, "# Voters"=w55, "Vote Count"=w56)
                Divide(x=w53, y=w54) -> w57
                Subtract(x=1, y=w57) -> w58
                $Countdown <- w58
                Build Array(w56, w55) -> w59
                for {
                  w60 = each element of ["# Votes Cast", "Electorate Size"]
                  w61 = each element of w59
                  Build Cluster(w60, w61) -> w63
                  append w63 to w62
                }
                $"Current Vote Status" <- w62
              }
              frame "Drive Status", "Scoreboard" {
                w48 = w46
              }
            }
            call "Enqueue Message (Single).gviweb"(message queue in=w17, message="Read", error in=w48) -> (error out=w21)
          }
          frame 56 {
            call "Clear Error Cluster.gvi"(error in=w43) -> (error out=w64)
            call "Enqueue Message (Single).gviweb"(message queue in=w17, message="Read", error in=w64) -> (error out=w21)
          }
        }
      }
      frame "Back", "Forward", "Left", "Right" {
        Property Node(instance in=s3) -> ("websocket"=w65, instance out=w22)
        w66 = cluster{"command": string, "data": string} {all zero or empty}
        Property Node(instance in=w66, "command"="Vote", "data"=w18) -> (instance out=w67)
        Flatten To JSON(anything=w67, error in (no error)=w20) -> (JSON string=w68, error out=w69)
        call "Write String.gvi"(websocket session in=w65, string message=w68, error in=w69) -> (error out=w70)
        case (w70) {
          frame Error, Default {
            call "Enqueue Message (Single).gviweb"(message queue in=w17, message="Disconnected") -> (error out=w71)
            Merge Errors(w71, w70) -> (error out=w21)
          }
          frame No Error {
            w21 = w70
          }
        }
      }
      frame "Disconnected" {
        Property Node(instance in=s3, "Connected?"=FALSE) -> ("websocket"=w72, instance out=w22)
        call "Close WebSocket.gvi"(websocket session in=w72) -> (error out=w73)
        call "Clear Error Cluster.gvi"(error in=w73)
        $"Current Vote Status" <- cluster{"Stat": string, "Count": f64}[] []
        # ignore errors
        $"Last Result" <- cluster{"Vote": string, "Count": f64}[] []
        call "Enqueue Message (Array).gviweb"(message queue in=w17, message array=["Update Display", "Connect"], error in=w20) -> (error out=w21)
      }
      frame "Error" {
        w21 = w20
        w22 = s3
      }
      frame "---Copy This Frame---" {
        Merge Errors(w20) -> (error out=w21)
        w22 = s3
      }
      frame Default {
        w74 = "The invalid message string \"%s\" was received in the Message Handling Loop."
        Format Into String(formatString=w74, w18) -> w75
        call "Build Error Cluster.gvi"(code=1, description=w75) -> (error out=w21)
        w22 = s3
      }
    }
    next s3 = w22
    stop if FALSE
  }
  Merge Errors(w8, w21)
